# Grasshopper definition filterDemo.gh (Grasshopper 0.9.76)
# plug-ins: Python Interpreter

box = CenterBox(Base=PlaneXY(0, 0, 0), X=10, Y=10, Z=10)
number_slider = Slider(1.59, range=-10.5..10.5)
pop3d = Populate3D(Region=box, Count=100, Seed=1)
pdecon = Deconstruct(Point=pop3d)  # -> XComponent, YComponent, ZComponent
larger = LargerThan(FirstNumber=pdecon.XComponent, SecondNumber=number_slider)  # -> LargerThan, OrEqualTo

# ---- group: docs
python = PythonScript(points=pop3d, threshold=number_slider)  # -> out, a; inputs points: list of Point3d; disabled
# ---------- python: Python ----------
import rhinoscriptsyntax as rs

print points

radius = 1
a = []
for p in points:
    if p.X > threshold:
        ball = rs.AddSphere(p, radius)
        a.append(ball)

print """Make balls if the points are bigger than a threshold.

Then here you'd write some really useful stuff about how to use this.

Written by: Ben
Date: 2019-08-09
Updated: not yet
"""
# ---------- end python ----------

# ---- group: List access
python_2 = PythonScript(pt_x=pdecon.XComponent, threshold=number_slider)  # -> out, a; inputs pt_x: list; disabled
# ---------- python_2: Python ----------
a = []
for value in pt_x:
    a.append(value > threshold)
# ---------- end python_2 ----------

# ---- group: geometry maker
python_3 = PythonScript(points=pop3d, threshold=number_slider)  # -> out, a; inputs points: list of Point3d; disabled
# ---------- python_3: Python ----------
import rhinoscriptsyntax as rs

print points

radius = 1
a = []
for p in points:
    if p.X > threshold:
        ball = rs.AddSphere(p, radius)
        a.append(ball)
# ---------- end python_3 ----------

# ---- group: Simple
python_4 = PythonScript(pt_x=pdecon.XComponent, threshold=number_slider)  # -> out, a; disabled
# ---------- python_4: Python ----------
a = pt_x > threshold
# ---------- end python_4 ----------

# ----
cull = CullPattern(List=pop3d, CullPattern=larger.LargerThan)
panel = Panel(python.out)  # disabled
sph = Sphere(Base=cull, Radius=1)
